# Grasshopper definition Sub-6.gh (Grasshopper 1.0.7)
# plug-ins: Human, Kangaroo Components

brep = Brep(<brep referenced from the Rhino model>)
brep_2 = Brep(<brep referenced from the Rhino model>)
brep_3 = Brep(<brep referenced from the Rhino model>)
group = Group(Objects=brep_2)
panel = Panel("""21321112133211
23221233211123
21111111111111""")
python = GhPythonScript()  # -> out, a
# ---------- python: Python ----------
__author__ = "Platina"
__version__ = "2019.01.09"

import rhinoscriptsyntax as rs
import random

a = []
for i in range(700):
    s = '2'
    for j in range(13):
        temp = int(random.random()*3+1)
        s = s + str(temp)
    a.append(s)
# ---------- end python ----------
python_2 = GhPythonScript()  # -> out, a
# ---------- python_2: Python ----------
__author__ = "Platina"
__version__ = "2019.01.09"

import rhinoscriptsyntax as rs
import random

a = []
for i in range(13):
    for k1 in range(3):
        for k2 in range(3):
            if k1!=k2:
                s = '2'
                for j in range(13):
                    if j==i:
                        temp = str(k1+1)
                    else:
                        temp = str(k2+1)
                    s = s + str(temp)
                a.append(s)
a.append('21111111111111')
a.append('22222222222222')
a.append('23333333333333')
# ---------- end python_2 ----------

# ---- group: 开启force生成
toggle = BooleanToggle(False)

# ----
panel_2 = Panel("""0
0
0""")
panel_3 = Panel("""-1
0
1
2
-1
-1
3
4
5""")

# ---- group: 开启form生成
toggle_2 = BooleanToggle(False)

# ---- group: constrains
crv = Curve([<curve referenced from the Rhino model> x2])

# ----
number_slider = Slider(18, range=0..100)
number_slider_2 = Slider(100, range=0..1000)
number_slider_3 = Slider(0, range=0..10000)
number_slider_4 = Slider(0, range=0..10000)
series = Series(Start=0, Step=Slider(300, range=0..10000), Count=number_slider)
subtraction = Subtraction(A=number_slider_4, B=30)
subtraction_2 = Subtraction(A=subtraction, B=30)
dup = DuplicateData(Data=series, Number=number_slider, Order=False)
dup_2 = DuplicateData(Data=series, Number=number_slider, Order=True)
X = UnitX(Factor=dup_2)
pt = ConstructPoint(XCoordinate=number_slider_3, YCoordinate=number_slider_4, ZCoordinate=number_slider_2)
pt_2 = ConstructPoint(XCoordinate=number_slider_3, YCoordinate=subtraction_2, ZCoordinate=number_slider_2)
Y = UnitY(Factor=dup)
pt_3 = ConstructPoint(XCoordinate=number_slider_3, YCoordinate=subtraction, ZCoordinate=number_slider_2)
addition = Addition(A=X, B=Y)
graft = GraftTree(Tree=addition, IncludeEmptyLists=True, IncludeNullItems=True)  # -> simplify(Tree)
colour = ColourPicker(PickedColour=RGBA(0, 0, 0, 65))
colour_2 = ColourPicker(PickedColour=RGB(0, 255, 255))
colour_3 = ColourPicker(PickedColour=RGB(0, 255, 0))
move = Move(Geometry=pt, Motion=graft)  # -> Geometry, Transform
move_2 = Move(Geometry=pt_2, Motion=graft)  # -> Geometry, Transform
move_3 = Move(Geometry=pt_3, Motion=graft)  # -> Geometry, Transform
data = Data()
number_slider_5 = Slider(2, range=0..100)  # disabled
join = TextJoin(Text=["最优差数据Loop3", "::测试得分2"])
join_2 = TextJoin(Text=["最优差数据Loop3", "::测试得分"])
join_3 = TextJoin(Text=["最优差数据Loop3", "::测试序列"])
python_3 = GhPythonScript(x=join_3)  # -> out, a
# ---------- python_3: Python ----------
__author__ = "Platina"
__version__ = "2019.02.02"

import rhinoscriptsyntax as rs
import scriptcontext as sc
import Rhino

sc.doc = Rhino.RhinoDoc.ActiveDoc
a = rs.ObjectsByLayer(x)
# ---------- end python_3 ----------
python_4 = GhPythonScript(x=join_2)  # -> out, a; same code as python_3
python_5 = GhPythonScript(x=join)  # -> out, a; same code as python_3
txtobjinfo = TextObjectInfo(TextObjects=python_3.a)  # -> Plane, Text, Size, Alignment, VerticalAlignment
txtobjinfo_2 = TextObjectInfo(TextObjects=python_4.a)  # -> Plane, Text, Size, Alignment, VerticalAlignment
txtobjinfo_3 = TextObjectInfo(TextObjects=python_5.a)  # -> Plane, Text, Size, Alignment, VerticalAlignment
multiplication = Multiplication(A=txtobjinfo_3.Text, B="1000000")
multiplication_2 = Multiplication(A=txtobjinfo_2.Text, B="1000000")
sort = SortList(Keys=txtobjinfo_2.Text, ValuesA=txtobjinfo.Text)  # -> Keys, ValuesA
subtraction_3 = Subtraction(A=multiplication, B="600000")
subtraction_4 = Subtraction(A=multiplication_2, B="600000")
item = ListItem(List=sort.Keys, Index=0, Wrap=True)
item_2 = ListItem(List=sort.Keys, Index=-1, Wrap=True)
item_3 = ListItem(List=sort.ValuesA, Index=0, Wrap=True)
item_4 = ListItem(List=sort.ValuesA, Index=-1, Wrap=True)
subtraction_5 = Subtraction(A="1000000", B="600000")
multiplication_3 = Multiplication(A=data, B=subtraction_5)
addition_2 = Addition(A="600000", B=multiplication_3)
division = Division(A=addition_2, B="1000000")
division_2 = Division(A=subtraction_3, B=subtraction_5)
division_3 = Division(A=subtraction_4, B=subtraction_5)

# ---- group: Max Found
panel_4 = Panel(item_2)
panel_5 = Panel(item_4)

# ---- group: Min Found
panel_6 = Panel(item)
panel_7 = Panel(item_3)

# ----
subtraction_6 = Subtraction(A=division_3, B=division_2)
abs = Absolute(Value=subtraction_6)
subset = SubList(List=abs, Domain=Domain(200, 299), Wrap=True)  # -> List, Index
subset_2 = SubList(List=abs, Domain=Domain(0, 99), Wrap=True)  # -> List, Index
subset_3 = SubList(List=abs, Domain=Domain(100, 199), Wrap=True)  # -> List, Index
avr = Average(Input=subset.List)
avr_2 = Average(Input=subset_3.List)
avr_3 = Average(Input=subset_2.List)

# ---- group: Max Finding Loss (per instance |y0-y1|)
panel_8 = Panel(avr_3)

# ---- group: Min Finding Loss (per instance |y0-y1|)
panel_9 = Panel(avr)

# ---- group: Mid (Random) Finding Loss (per instance |y0-y1|)
panel_10 = Panel(avr_2)

# ----
txt = Text()

lng = ListLength(List=txt)
dup_3 = DuplicateData(Data=group, Number=lng, Order=True)
ungroup = Ungroup(Group=dup_3)  # -> simplify(Objects)

brep_4 = Brep(ungroup)

# ---- group: force输入
brep_5 = Brep(brep_4)
txt_2 = Text(txt)

# ----
path_mapper = PathMapper(brep_5, source="{a}", target="{0;a}")
graft_2 = GraftTree(Tree=txt_2, IncludeEmptyLists=True, IncludeNullItems=True)  # -> simplify(Tree)
debrep = DeconstructBrep(Brep=brep_5)  # -> Faces, Edges, Vertices
path_mapper_2 = PathMapper(debrep.Edges, source="{a;b}", target="{0;a}")
path_mapper_3 = PathMapper(debrep.Faces, source="{a;b}", target="{0;a}")
path_mapper_4 = PathMapper(debrep.Vertices, source="{a;b}", target="{0;a}")
path_mapper_5 = PathMapper(graft_2, source="{a}", target="{0;a}")
python_6 = GhPythonScript(
    celltotal=path_mapper,
    facestotal=path_mapper_3,
    edgestotal=path_mapper_2,
    vertexestotal=path_mapper_4,
    subdivisiontotal=path_mapper_5,
    pleaserun=toggle)  # -> cellloop1, cellout, facesout, edgesout, vertexesout, ruleout; inputs celltotal: tree of Brep, facestotal: tree of Brep, edgestotal: tree of Curve, vertexestotal: tree of Point3d, subdivisiontotal: tree, pleaserun: Boolean
# ---------- python_6: Python ----------
__author__ = "Hao"
__version__ = "2019.1.19"


import rhinoscriptsyntax as rs
import ghpythonlib.treehelpers as ghtree
import ghpythonlib.components as gh
import copy
import time

celltotal = ghtree.tree_to_list(celltotal)
facestotal = ghtree.tree_to_list(facestotal)
edgestotal = ghtree.tree_to_list(edgestotal)
vertexestotal = ghtree.tree_to_list(vertexestotal)
subdivisiontotal = ghtree.tree_to_list(subdivisiontotal)


def sub1(cell,faces,edges,vertexes):
    returncell = []
    returnfaces = []
    returnedges = []
    returnvertexes = []
    try:
        len(cell)
    except:
        cell = cell
    else:
        cell = cell[0]
    centerpt = rs.SurfaceAreaCentroid(cell)[0]
    for face in faces:
        temp = gh.DeconstructBrep(face)
        pts = []
        pts.extend(temp[2])
        pts.append(temp[2][0])
        tempfaces = []
        tempfaces.append(face)
        for i in range(len(pts)-1):
            tempfaces.append(gh.x4PointSurface(pts[i],centerpt,pts[i+1]))
        tempcell = gh.BrepJoin(tempfaces)[0]
        tempedges = []
        for i in range(len(pts)-1):
            tempedges.append(gh.Line(pts[i],pts[i+1]))
            tempedges.append(gh.Line(pts[i],centerpt))
        tempvertexes = []
        tempvertexes.extend(temp[2])
        tempvertexes.append(centerpt)
        returncell.append(tempcell)
        returnfaces.append(tempfaces)
        returnedges.append(tempedges)
        returnvertexes.append(tempvertexes)
    return returncell,returnfaces,returnedges,returnvertexes

def sub2(cell,faces,edges,vertexes,rate):
    returncell = []
    returnfaces = []
    returnedges = []
    returnvertexes = []
    try:
        len(cell)
    except:
        cell = cell
    else:
        cell = cell[0]
    centerpt = rs.SurfaceAreaCentroid(cell)[0]
    for face in faces:
        print face
        temp = gh.DeconstructBrep(face)
        pts = []
        pts.extend(temp[2])
        pts.append(temp[2][0])
        face2 = gh.Scale(face,centerpt,rate)[0]
        temp2 = gh.DeconstructBrep(face2)
        pts2 = []
        pts2.extend(temp2[2])
        pts2.append(temp2[2][0])
        tempfaces = []
        tempfaces.append(face)
        for i in range(len(pts)-1):
            tempfaces.append(gh.x4PointSurface(pts[i],pts[i+1],pts2[i+1],pts2[i]))
        tempfaces.append(face2)
        tempcell = gh.BrepJoin(tempfaces)[0]
        tempedges = []
        for i in range(len(pts)-1):
            tempedges.append(gh.Line(pts[i],pts[i+1]))
            tempedges.append(gh.Line(pts2[i],pts2[i+1]))
            tempedges.append(gh.Line(pts[i],pts2[i]))
        tempvertexes = []
        tempvertexes.extend(temp[2])
        tempvertexes.extend(temp2[2])
        returncell.append(tempcell)
        returnfaces.append(tempfaces)
        returnedges.append(tempedges)
        returnvertexes.append(tempvertexes)
    centercell = gh.Scale(cell,centerpt,rate)[0]
    centerfaces = gh.Scale(faces,centerpt,rate)[0]
    centeredges = gh.Scale(edges,centerpt,rate)[0]
    centervertexes = gh.Scale(vertexes,centerpt,rate)[0]
    returncell.append(centercell)
    returnfaces.append(centerfaces)
    returnedges.append(centeredges)
    returnvertexes.append(centervertexes)
    return returncell,returnfaces,returnedges,returnvertexes

def sub3(cell,faces,edges,vertexes,rate):
    temp = sub2(cell,faces,edges,vertexes,rate)
    temp2 = sub1(temp[0].pop(),temp[1].pop(),temp[2].pop(),temp[3].pop())
    for i in range(4):
        temp[i].extend(temp2[i])
    return temp

def sub6(cell,faces,edges,vertexes):
    returncell = []
    returnfaces = []
    returnedges = []
    returnvertexes = []
    try:
        len(cell)
    except:
        cell = cell
    else:
        cell = cell[0]
    centerpt = rs.SurfaceAreaCentroid(cell)[0]
    for face in faces:
        facecenterpt = gh.Area(face)[1]
        temp = gh.DeconstructBrep(face)
        pts = []
        pts.extend(temp[2])
        pts.append(temp[2][0])
        for i in range(len(pts)-1):
            tempfaces = []
            tempfaces.append(gh.x4PointSurface(pts[i],pts[i+1],facecenterpt))
            tempfaces.append(gh.x4PointSurface(pts[i],pts[i+1],centerpt))
            tempfaces.append(gh.x4PointSurface(pts[i+1],facecenterpt,centerpt))
            tempfaces.append(gh.x4PointSurface(pts[i],facecenterpt,centerpt))
            tempcell = gh.BrepJoin(tempfaces)[0]
            tempedges = []
            tempedges.append(gh.Line(pts[i],pts[i+1]))
            tempedges.append(gh.Line(pts[i+1],facecenterpt))
            tempedges.append(gh.Line(facecenterpt,pts[i]))
            tempedges.append(gh.Line(pts[i],centerpt))
            tempedges.append(gh.Line(pts[i+1],centerpt))
            tempedges.append(gh.Line(facecenterpt,centerpt))
            tempvertexes = []
            tempvertexes.append(pts[i])
            tempvertexes.append(pts[i+1])
            tempvertexes.append(facecenterpt)
            tempvertexes.append(centerpt)
            returncell.append(tempcell)
            returnfaces.append(tempfaces)
            returnedges.append(tempedges)
            returnvertexes.append(tempvertexes)
    return returncell,returnfaces,returnedges,returnvertexes

def sub7(cell,faces,edges,vertexes):
    returncell = []
    returnfaces = []
    returnedges = []
    returnvertexes = []
    try:
        len(cell)
    except:
        cell = cell
    else:
        cell = cell[0]
    centerpt = rs.SurfaceAreaCentroid(cell)[0]
    for face in faces:
        facecenterpt = gh.Area(face)[1]
        temp = gh.DeconstructBrep(face)
        pts = []
        pts.extend(temp[2])
        pts.append(temp[2][0])
        for i in range(len(pts)-1):
            edgecenterpt = gh.Average([pts[i],pts[i+1]])
            tempfaces = []
            tempfaces.append(gh.x4PointSurface(pts[i],edgecenterpt,facecenterpt))
            tempfaces.append(gh.x4PointSurface(pts[i],edgecenterpt,centerpt))
            tempfaces.append(gh.x4PointSurface(edgecenterpt,facecenterpt,centerpt))
            tempfaces.append(gh.x4PointSurface(pts[i],facecenterpt,centerpt))
            tempcell = gh.BrepJoin(tempfaces)[0]
            tempedges = []
            tempedges.append(gh.Line(pts[i],edgecenterpt))
            tempedges.append(gh.Line(edgecenterpt,facecenterpt))
            tempedges.append(gh.Line(facecenterpt,pts[i]))
            tempedges.append(gh.Line(pts[i],centerpt))
            tempedges.append(gh.Line(edgecenterpt,centerpt))
            tempedges.append(gh.Line(facecenterpt,centerpt))
            tempvertexes = []
            tempvertexes.append(pts[i])
            tempvertexes.append(edgecenterpt)
            tempvertexes.append(facecenterpt)
            tempvertexes.append(centerpt)
            returncell.append(tempcell)
            returnfaces.append(tempfaces)
            returnedges.append(tempedges)
            returnvertexes.append(tempvertexes)
            tempfaces = []
            tempfaces.append(gh.x4PointSurface(edgecenterpt,pts[i+1],facecenterpt))
            tempfaces.append(gh.x4PointSurface(edgecenterpt,pts[i+1],centerpt))
            tempfaces.append(gh.x4PointSurface(pts[i+1],facecenterpt,centerpt))
            tempfaces.append(gh.x4PointSurface(edgecenterpt,facecenterpt,centerpt))
            tempcell = gh.BrepJoin(tempfaces)[0]
            tempedges = []
            tempedges.append(gh.Line(edgecenterpt,pts[i+1]))
            tempedges.append(gh.Line(pts[i+1],facecenterpt))
            tempedges.append(gh.Line(facecenterpt,edgecenterpt))
            tempedges.append(gh.Line(edgecenterpt,centerpt))
            tempedges.append(gh.Line(pts[i+1],centerpt))
            tempedges.append(gh.Line(facecenterpt,centerpt))
            tempvertexes = []
            tempvertexes.append(edgecenterpt)
            tempvertexes.append(pts[i+1])
            tempvertexes.append(facecenterpt)
            tempvertexes.append(centerpt)
            returncell.append(tempcell)
            returnfaces.append(tempfaces)
            returnedges.append(tempedges)
            returnvertexes.append(tempvertexes)
    return returncell,returnfaces,returnedges,returnvertexes

def sub8(cell,faces,edges,vertexes,rate):
    returncell = []
    returnfaces = []
    returnedges = []
    returnvertexes = []
    try:
        len(cell)
    except:
        cell = cell
    else:
        cell = cell[0]
    centerpt = rs.SurfaceAreaCentroid(cell)[0]
    for face in faces:
        temp = gh.DeconstructBrep(face)
        pts = []
        pts.extend(temp[2])
        pts.append(temp[2][0])
        face2 = gh.Scale(face,gh.Area(face)[1],rate)[0]
        temp2 = gh.DeconstructBrep(face2)
        pts2 = []
        pts2.extend(temp2[2])
        pts2.append(temp2[2][0])
        for i in range(len(pts)-1):
            tempfaces = []
            tempfaces.append(gh.x4PointSurface(pts[i],pts[i+1],pts2[i+1],pts2[i]))
            tempfaces.append(gh.x4PointSurface(pts[i],pts[i+1],centerpt))
            tempfaces.append(gh.x4PointSurface(pts[i+1],pts2[i+1],centerpt))
            tempfaces.append(gh.x4PointSurface(pts2[i+1],pts2[i],centerpt))
            tempfaces.append(gh.x4PointSurface(pts2[i],pts[i],centerpt))
            tempcell = gh.BrepJoin(tempfaces)[0]
            tempedges = []
            tempedges.append(gh.Line(pts[i],pts[i+1]))
            tempedges.append(gh.Line(pts[i+1],pts2[i+1]))
            tempedges.append(gh.Line(pts2[i+1],pts2[i]))
            tempedges.append(gh.Line(pts2[i],pts[i]))
            tempedges.append(gh.Line(pts[i],centerpt))
            tempedges.append(gh.Line(pts[i+1],centerpt))
            tempedges.append(gh.Line(pts2[i+1],centerpt))
            tempedges.append(gh.Line(pts2[i],centerpt))
            tempvertexes = []
            tempvertexes.append(pts[i])
            tempvertexes.append(pts[i+1])
            tempvertexes.append(pts2[i+1])
            tempvertexes.append(pts2[i])
            tempvertexes.append(centerpt)
            returncell.append(tempcell)
            returnfaces.append(tempfaces)
            returnedges.append(tempedges)
            returnvertexes.append(tempvertexes)
        centerfaces = []
        centerfaces.append(face2)
        for i in range(len(pts2)-1):
            centerfaces.append(gh.x4PointSurface(pts2[i],pts2[i+1],centerpt))
        centercell = gh.BrepJoin(centerfaces)[0]
        centeredges = []
        for i in range(len(pts2)-1):
            centeredges.append(gh.Line(pts2[i],pts2[i+1]))
        for i in range(len(pts2)-1):
            centeredges.append(gh.Line(pts2[i],centerpt))
        centervertexes = []
        for i in range(len(pts2)-1):
            centervertexes.append(pts2[i])
        centervertexes.append(centerpt)
        returncell.append(centercell)
        returnfaces.append(centerfaces)
        returnedges.append(centeredges)
        returnvertexes.append(centervertexes)
    return returncell,returnfaces,returnedges,returnvertexes


cellrec = []
facesrec = []
edgesrec = []
vertexesrec = []
rulerec = []
cellloop1 = []

if pleaserun:
    i = 0
    for celli in range(len(celltotal)):
        cell = celltotal[i]
        faces = [facestotal[i]]
        edges = [edgestotal[i]]
        vertexes = [vertexestotal[i]]
        subdivision = subdivisiontotal[i][0]
        rule = []
        j = 0
        stoplength = 1
        loopcount = 0
        while j<stoplength:
            rule.append(subdivision[j])
            if subdivision[j] == '1':
                temp = sub1(cell[j],faces[j],edges[j],vertexes[j])
                cell.extend(temp[0])
                faces.extend(temp[1])
                edges.extend(temp[2])
                vertexes.extend(temp[3])
            elif subdivision[j] == '2':
                temp = sub2(cell[j],faces[j],edges[j],vertexes[j],0.5)
                cell.extend(temp[0])
                faces.extend(temp[1])
                edges.extend(temp[2])
                vertexes.extend(temp[3])
            elif subdivision[j] == '3':
                temp = sub3(cell[j],faces[j],edges[j],vertexes[j],0.66666)
                cell.extend(temp[0])
                faces.extend(temp[1])
                edges.extend(temp[2])
                vertexes.extend(temp[3])
            elif subdivision[j] == '6':
                temp = sub6(cell[j],faces[j],edges[j],vertexes[j])
                cell.extend(temp[0])
                faces.extend(temp[1])
                edges.extend(temp[2])
                vertexes.extend(temp[3])
            elif subdivision[j] == '7':
                temp = sub7(cell[j],faces[j],edges[j],vertexes[j])
                cell.extend(temp[0])
                faces.extend(temp[1])
                edges.extend(temp[2])
                vertexes.extend(temp[3])
            elif subdivision[j] == '8':
                temp = sub8(cell[j],faces[j],edges[j],vertexes[j],0.5)
                cell.extend(temp[0])
                faces.extend(temp[1])
                edges.extend(temp[2])
                vertexes.extend(temp[3])
            j = j + 1
            if (j>=1) and (loopcount<=0):
                loopcount = loopcount + 1
                stoplength = len(cell)
                cellloop1.append(cell[j:])
        cellrec.append(cell[j:])
        facesrec.append(faces[j:])
        edgesrec.append(edges[j:])
        vertexesrec.append(vertexes[j:])
        #cellrec.append(cell)
        #facesrec.append(faces)
        #edgesrec.append(edges)
        #vertexesrec.append(vertexes)
        rulerec.append(rule)
        i = i + 1


cellout = ghtree.list_to_tree(cellrec)
facesout = ghtree.list_to_tree(facesrec)
edgesout = ghtree.list_to_tree(edgesrec)
vertexesout = ghtree.list_to_tree(vertexesrec)
ruleout = ghtree.list_to_tree(rulerec)
cellloop1 = ghtree.list_to_tree(cellloop1)
# ---------- end python_6 ----------
brep_6 = Brep(simplify(python_6.cellloop1))
brep_7 = Brep(simplify(python_6.cellout))
srf = Surface(simplify(python_6.facesout))
pt_4 = Point(simplify(python_6.vertexesout))
crv_2 = Curve(simplify(python_6.edgesout))
txt_3 = Text(simplify(python_6.ruleout))

# ---- group: force查看
branch = TreeBranch(Tree=brep_6, Path=Slider(0, range=0..399), MaintainPaths=True)

# ----
vertexes = Point(pt_4)
cells = Brep(brep_7)

# ---- group: force查看
branch_2 = TreeBranch(Tree=cells, Path=Slider(0, range=0..399), MaintainPaths=True)

# ----
faces = Surface(srf)
edges = Curve(crv_2)
rules = Text(txt_3)
data_2 = Data(rules)
shift = ShiftList(List=data_2, Shift=1, Wrap=False)
item_5 = ListItem(List=panel_3, Index=shift, Wrap=True)
graft_3 = GraftTree(Tree=item_5, IncludeEmptyLists=True, IncludeNullItems=True)  # -> simplify(Tree)
trim = TrimTree(Tree=edges, Depth=1)
join_4 = TextJoin(Text=rules)  # -> flatten(Result)
trim_2 = TrimTree(Tree=vertexes, Depth=1)
trim_3 = TrimTree(Tree=faces, Depth=1)
replace = ReplaceItems(List=panel_2, Item=1, Indices=graft_3, Wrap=False)  # -> simplify(List)
group_2 = Group(Objects=cells)  # -> flatten(Group)
trim_4 = TrimTree(Tree=replace, Depth=1)
path_mapper_6 = PathMapper(trim_4, source="{a}", target="{0;a}")

# ---- group: nnin
panel_11 = Panel(trim_4)

# ----
python_7 = GhPythonScript(cellout=group_2, pleaserun=toggle_2, constrains=crv)  # -> out, InternalLines, ExternalForces, ExternalPoly, edgelengths, faceareas, lines, mibfs; inputs cellout: list, constrains: list of Curve
# ---------- python_7: Python ----------
__author__ = "Hao"
__version__ = "2018.1.28"

import rhinoscriptsyntax as rs
import scriptcontext as sc
import Rhino
import ghpythonlib.treehelpers as ghtree
import math
import ghpythonlib.components as gh

import clr
import os
import time
clr.AddReferenceToFileAndPath("C:\\PolyFramework\\PolyFramework.dll")

import Rhino.Geometry as rg
import PolyFramework as pf

if pleaserun :
    
    InternalLines = []
    ExternalForces = []
    ExternalPoly = []
    
    edgelengths = []
    faceareas = []
    lines = []
    mibfs = []
    
    for cells in cellout:
        rs.Command("_SelAll")
        rs.Command("_Delete")
        
        sc.doc = Rhino.RhinoDoc.ActiveDoc
        [sc.doc.Objects.Add(cell) for cell in cells]
        
        rs.Command("_SelAll")
        rs.Command(' _PFBuild ' + ' _Enter ' + ' _Enter ' + ' _Enter ' + ' _Enter ')
        rs.Command("_SelAll")
        rs.Command(' _PFDual ' + ' _Enter ' + ' _Enter ' + ' _Enter ' + ' _Enter ' + ' _Enter ')
        rs.Command("_SelAll")
        
        primal = pf.PFoam()
        dual = pf.PFoam()
        containerType = pf.ContainerType
        multiData = pf.LoadData.LoadPrimalDual(True)
        
        guids = multiData[0]
        primal = multiData[1]
        dual = multiData[2]
        containerType = multiData[3]
        
        geoouttemp = rs.ObjectsByLayer('_Form_ExternalForces')
        geoouttemp = [rs.coercecurve(j) for j in geoouttemp]
        ExternalForcestemp = geoouttemp
        pt1 = gh.EndPoints(ExternalForcestemp)[0]
        pt2 = gh.EndPoints(ExternalForcestemp)[1]
        pt = []
        for i in range(len(pt1)):
            if rs.VectorLength(pt1[i])>rs.VectorLength(pt2[i]):
                pt.append(pt2[i])
            else:
                pt.append(pt1[i])
        ptz = gh.DeconstructVector(pt)[2]
        pt = gh.SortList(ptz,pt)[1]
        ptup = []
        ptdown = []
        for i in range(len(pt)):
            if i<=5:
                ptdown.append(pt[i])
            else:
                ptup.append(pt[i])
        pickedVertsup = []
        pickedVertsdown = []
        fixableVerts ={}
        for vert in primal.Vertices:
            id = vert.Id
            location = vert.Point
            for i in range(len(ptup)):
                if rs.Distance(ptup[i],location)<0.01:
                    fixableVerts[location] = vert
                    pickedVertsup.append(fixableVerts[location])
                    break
            for i in range(len(ptdown)):
                if rs.Distance(ptdown[i],location)<0.01:
                    fixableVerts[location] = vert
                    pickedVertsdown.append(fixableVerts[location])
                    break
        primal.SetVertexConstraints(pickedVertsup, constrains[0], 1.0, True)
        primal.SetVertexConstraints(pickedVertsdown, constrains[1], 1.0, True)
        
        for edge in primal.Edges:
            edge.MinLength = 1
            edge.MaxLength = 100
        
        primal.PerpSoft(maxSteps = 10000, conVAngle = 0.088)
        
        rs.Command("_SelAll")
        rs.Command("_Delete")
        bakeout = pf.PFoam.SaveAsEdges(primal)
        
        geoouttemp = rs.ObjectsByLayer('_Form_InternalLines')
        geoouttemp = [rs.coercecurve(j) for j in geoouttemp]
        InternalLines.append(geoouttemp)
        geoouttemp = rs.ObjectsByLayer('_Form_ExternalForces')
        geoouttemp = [rs.coercecurve(j) for j in geoouttemp]
        ExternalForces.append(geoouttemp)
        geoouttemp = rs.ObjectsByLayer('_Form_ExternalPoly')
        geoouttemp = [rs.coercecurve(j) for j in geoouttemp]
        ExternalPoly.append(geoouttemp)
        
        rs.Command("_SelAll")
        primal = pf.PFoam()
        dual = pf.PFoam()
        containerType = pf.ContainerType
        multiData = pf.LoadData.LoadPrimalDual(True)
        
        guids = multiData[0]
        primal = multiData[1]
        dual = multiData[2]
        containerType = multiData[3]
        
        elasticity = 200
        unsupportedk = 1
        areatoradiusk = 1
        
        edgetemp = []
        facetemp = []
        linestemp = []
        rec = 9999999999999999999999999999999
        for edge in primal.Edges:
            if (edge.Dual) and (edge.Id>=0):
                if (edge.GetLength()>0) and (edge.Dual.Area>0):
                    linestemp.append(edge.CreateLine())
                    edgelength = edge.GetLength()
                    edgetemp.append(edge.GetLength())
                    facearea = edge.Dual.Area
                    facetemp.append(edge.Dual.Area)
                    criticalstress = pow(math.pi,2)*elasticity/pow(unsupportedk*(edgelength/(facearea*areatoradiusk)),2)
                    bucklingforce = criticalstress*facearea
                    if bucklingforce<rec:
                        rec = bucklingforce
        mibf = rec #minimum_internal_buckling_force
        
        edgelengths.append(edgetemp)
        faceareas.append(facetemp)
        lines.append(linestemp)
        mibfs.append(mibf)
        
        rs.Command("_SelAll")
        rs.Command("_Delete")
        
    InternalLines = ghtree.list_to_tree(InternalLines)
    ExternalForces = ghtree.list_to_tree(ExternalForces)
    ExternalPoly = ghtree.list_to_tree(ExternalPoly)
    edgelengths = ghtree.list_to_tree(edgelengths)
    faceareas = ghtree.list_to_tree(faceareas)
    lines = ghtree.list_to_tree(lines)
    mibfs = ghtree.list_to_tree(mibfs)
# ---------- end python_7 ----------

# ---- group: vox
python_8 = GhPythonScript(x=path_mapper_6, run=Toggle(False))  # -> out, a; inputs x: tree
# ---------- python_8: Python ----------
__author__ = "Hao"
__version__ = "2019.01.13"

import rhinoscriptsyntax as rs
import ghpythonlib.treehelpers as ghtree

x = ghtree.tree_to_list(x)

if run:
    with open('nnin.txt', 'w') as f:
        for i in range(len(x)):
            for j in range(len(x[i])):
                f.write(x[i][j]+'\n')
# ---------- end python_8 ----------

# ---- group: form输出
crv_3 = Curve(simplify(python_7.ExternalPoly))
crv_4 = Curve(simplify(python_7.InternalLines))
crv_5 = Curve(simplify(python_7.ExternalForces))

# ----
edgelengths = Data(python_7.edgelengths)
faceareas = Data(python_7.faceareas)
crv_6 = Curve(crv_3)
crv_7 = Curve(crv_4)
crv_8 = Curve(crv_5)
lines = Curve(python_7.lines)
python_9 = GhPythonScript(K="1", A=faceareas, E="200", L=edgelengths)  # -> out, r; inputs A: tree, L: tree
# ---------- python_9: Python ----------
__author__ = "Hao"
__version__ = "2019.01.11"

import rhinoscriptsyntax as rs
import ghpythonlib.treehelpers as ghtree
import math

A = ghtree.tree_to_list(A)
L = ghtree.tree_to_list(L)

r = []
for i in range(len(A)):
    rtemp = []
    for j in range(len(A[i])):
        item1 = -math.sqrt((K*A[i][j])/(math.pi*math.pi*math.pi*E))
        item2 = math.sqrt((K*A[i][j]+math.sqrt(math.pi*math.pi*math.pi*E*K*A[i][j]*L[i][j]*L[i][j]))/(math.pi*math.pi*math.pi*E))
        rtemp.append(item1+item2)
    r.append(rtemp)

r = ghtree.list_to_tree(r)
# ---------- end python_9 ----------
end = EndPoints(Curve=lines)  # -> Start, End
merge = Merge(Data1=end.Start, Data2=end.End)
duppt = RemoveDuplicatePts(Points=merge, Tolerance=0.01)  # -> simplify(UniquePoints)
cp = ClosestPoint(Point=end.End, Cloud=duppt)  # -> ClosestPoint, CPIndex, Distance
cp_2 = ClosestPoint(Point=end.Start, Cloud=duppt)  # -> ClosestPoint, CPIndex, Distance
python_10 = GhPythonScript(x1=cp_2.CPIndex, x2=cp.CPIndex, r=python_9.r)  # -> out, rout, rsphere; inputs x1: tree of Int32, x2: tree of Int32, r: tree
# ---------- python_10: Python ----------
__author__ = "Platina"
__version__ = "2019.01.11"

import rhinoscriptsyntax as rs
import ghpythonlib.treehelpers as ghtree

x1 = ghtree.tree_to_list(x1)
x2 = ghtree.tree_to_list(x2)
r = ghtree.tree_to_list(r)

rout = []
rsphere = []
for i in range(len(x1)):
    rtemp = []
    rrec = []
    maxindex = 0
    for j in range(len(x1[i])):
        if x1[i][j]>maxindex:
            maxindex = x1[i][j]
        if x2[i][j]>maxindex:
            maxindex = x2[i][j]
    for j in range(maxindex+1):
        rtemp.append(0)
    for j in range(len(x1[i])):
        if rtemp[x1[i][j]]<r[i][j]:
            rtemp[x1[i][j]] = r[i][j]
    for j in range(len(x2[i])):
        if rtemp[x2[i][j]]<r[i][j]:
            rtemp[x2[i][j]] = r[i][j]
    for j in range(len(r[i])):
        if rtemp[x1[i][j]]>rtemp[x2[i][j]]:
            rrec.append(rtemp[x1[i][j]])
        else:
            rrec.append(rtemp[x2[i][j]])
    rout.append(rrec)
    rsphere.append(rtemp)

rout = ghtree.list_to_tree(rout)
rsphere = ghtree.list_to_tree(rsphere)
# ---------- end python_10 ----------
move_4 = Move(Geometry=crv_7, Motion=graft)  # -> Geometry, Transform

# ---- group: Final rsphere
panel_12 = Panel(python_10.rsphere)

# ----
move_5 = Move(Geometry=crv_6, Motion=graft)  # -> Geometry, Transform
move_6 = Move(Geometry=crv_8, Motion=graft)  # -> Geometry, Transform
multiplication_4 = Multiplication(A=python_10.rout, B=2)
group_3 = Group(Objects=move_4.Geometry)
group_4 = Group(Objects=move_6.Geometry)
group_5 = Group(Objects=move_5.Geometry)
subtraction_7 = Subtraction(A=edgelengths, B=multiplication_4)
pow = Power(A=panel_12, B=3)
max = Maximum(A=subtraction_7, B=0)

# ---- group: Final L
panel_13 = Panel(max)

# ----
multiplication_5 = Multiplication(A=pow, B="4/3*pi")
python_11 = GhPythonScript(K="1", A=faceareas, E="200", L=max)  # -> out, r; inputs A: tree, L: tree
# ---------- python_11: Python ----------
__author__ = "Platina"
__version__ = "2019.01.11"

import rhinoscriptsyntax as rs
import ghpythonlib.treehelpers as ghtree
import math

A = ghtree.tree_to_list(A)
L = ghtree.tree_to_list(L)

r = []
for i in range(len(L)):
    rtemp = []
    for j in range(len(L[i])):
        rtemp.append(math.sqrt(math.sqrt((K*A[i][j]*L[i][j]*L[i][j])/(math.pi*math.pi*math.pi*E))))
    r.append(rtemp)
    
r = ghtree.list_to_tree(r)
# ---------- end python_11 ----------
ma = MassAddition(Input=multiplication_5)  # -> Result, PartialResults

# ---- group: Final r
panel_14 = Panel(python_11.r)

# ----
sph = Sphere(Base=duppt, Radius=panel_12)  # disabled
pow_2 = Power(A=panel_14, B=2)
multiplication_6 = Multiplication(A=pow_2, B="pi")
multiplication_7 = Multiplication(A=multiplication_6, B=panel_13)
ma_2 = MassAddition(Input=multiplication_7)  # -> Result, PartialResults
pipe = Pipe(Curve=lines, Radius=panel_14, Caps=0)  # disabled
trim_5 = TrimTree(Tree=pipe, Depth=1)  # -> simplify(Tree); disabled
addition_3 = Addition(A=ma_2.Result, B=ma.Result)  # -> flatten(Result)
branch_3 = TreeBranch(Tree=trim_5, Path=number_slider_5, MaintainPaths=True)  # disabled
division_4 = Division(A=addition_3, B="1000000")

# ---- group: 测试图形可视化
tag = TextTag3D(Location=flatten(move.Geometry), Text=flatten(division_4), Size=20, Justification=5)
tag_2 = TextTag3D(Location=flatten(move_2.Geometry), Text=flatten(join_4), Size=10, Justification=5)
tag_3 = TextTag3D(Location=flatten(move_3.Geometry), Text=flatten(division), Size=20, Justification=5)
preview = CustomPreview(Geometry=group_4, Material=colour_3)
preview_2 = CustomPreview(Geometry=group_3, Material=colour_2)
preview_3 = CustomPreview(Geometry=group_5, Material=colour)

# ----
sort_2 = SortList(Keys=addition_3)  # -> Keys, ValuesA
item_6 = ListItem(List=sort_2.Keys, Index=0, Wrap=True)  # -> Item1, Item
panel_15 = Panel(item_6.Item1)
panel_16 = Panel(item_6.Item)
subtraction_8 = Subtraction(A=addition_3, B="600000")
division_5 = Division(A=subtraction_8, B=subtraction_5)

# ---- group: nnout
panel_17 = Panel(division_5)

# ---- group: vox
python_12 = GhPythonScript(x=division_5, run=Toggle(False))  # -> out, a; inputs x: list
# ---------- python_12: Python ----------
__author__ = "Hao"
__version__ = "2019.01.13"

import rhinoscriptsyntax as rs
import ghpythonlib.treehelpers as ghtree

if run:
    with open('nnout.txt', 'w') as f:
        for i in range(len(x)):
            f.write(x[i]+'\n')
# ---------- end python_12 ----------
